# Grasshopper definition gh-defination.gh (Grasshopper 0.9.76)

# ----
# v2 caculation tabble
# P<0
# .2
panel = Panel("""0 
0.0640
 0.1455
 0.3060
 0.4535
 0.5842
 0.6995
 0.7984
 0.9446""")
# P=>0
panel_2 = Panel("""0 
0.1560 
0.2840 
0.3905 
0.4777 
0.6190 
0.7277 
0.8170 
0.8875 
0.9750 
1""")
rev = ReverseList(List=panel_2)

# ----
# 1
panel_3 = Panel("""0 
0.0975 
0.19 
0.36 
0.51 
0.64 
0.75 
0.84 
0.96""")
panel_4 = Panel("""0 
0.0975 
0.1900 
0.2775 
0.3600 
0.51 
0.6400 
0.75 
0.8400 
0.9600 
1""")
rev_2 = ReverseList(List=panel_4)

# ----
# .5
panel_5 = Panel("""0 
0.0950 
0.1865 
0.3569 
0.5140 
0.6439 
0.7580 
0.8456 
0.9639""")
panel_6 = Panel("""0 
0.1750 
0.3056 
0.4135 
0.5039 
0.6430 
0.7478 
0.8275 
0.8880 
0.9710 
1""")
rev_3 = ReverseList(List=panel_6)

# ----
# .9
panel_7 = Panel("""0 
0.0975 
0.19 
0.36 
0.51 
0.64 
0.75 
0.84 
0.96""")
panel_8 = Panel("""0 
0.0975 
0.1900 
0.2775 
0.3600 
0.51 
0.6400 
0.75 
0.8400 
0.9600 
1""")
rev_4 = ReverseList(List=panel_8)

# ----
# .3
panel_9 = Panel("""0 
0.0800 
0.1670 
0.3360 
0.4885 
0.6195 
0.7335 
0.8265 
0.9583""")
panel_10 = Panel("""0 
0.1890 
0.3197 
0.4265 
0.5130 
0.6505 
0.7520 
0.8315 
0.8920 
0.9750 
1""")
rev_5 = ReverseList(List=panel_10)

# ----
# .4
panel_11 = Panel("""0 
0.0905 
0.1810 
0.3500 
0.5040 
0.6353 
0.7525 
0.8415 
0.9645""")
panel_12 = Panel("""0 
0.1935 
0.3235 
0.4335 
0.5220 
0.6590 
0.7593 
0.8345 
0.8933 
0.9725 
1""")
rev_6 = ReverseList(List=panel_12)

# ----
# .6
panel_13 = Panel("""0 
0.0965 
0.1885 
0.3585 
0.5110 
0.6415 
0.7530 
0.8426 
0.9613""")
panel_14 = Panel("""0 
0.1485 
0.2720 
0.3775 
0.4620 
0.6060 
0.7200 
0.8090 
0.8790 
0.9690 
1""")
rev_7 = ReverseList(List=panel_14)

# ----
# .7
panel_15 = Panel("""0 
0.0975 
0.19 
0.36 
0.51 
0.64 
0.75 
0.84 
0.96""")
panel_16 = Panel("""0 
0.1240 
0.2337 
0.3300 
0.4140 
0.5615 
0.6840 
0.7850 
0.8660 
0.9675 
1""")
rev_8 = ReverseList(List=panel_16)

# ----
# .8
panel_17 = Panel("""0 
0.0975 
0.19 
0.36 
0.51 
0.64 
0.75 
0.84 
0.96""")
panel_18 = Panel("""0 
0.1050 
0.2028 
0.2925 
0.3765 
0.5265 
0.6545 
0.7635 
0.8520 
0.9635 
1""")
rev_9 = ReverseList(List=panel_18)

# ----
# .9
panel_19 = Panel("""0
0
0
0
0
0
0
0
0""")
panel_20 = Panel("""0
0
0
0
0
0
0
0
0
0
0""")

# ----
# 1
panel_21 = Panel("""0
0
0
0
0
0
0
0
0""")
panel_22 = Panel("""0
0
0
0
0
0
0
0
0
0
0""")

# ----
# .8
panel_23 = Panel("""0
0
0
0
0
0
0
0
0""")
panel_24 = Panel("""0
0
0
0
0
0
0
0
0
0
0""")

# ----
# .5
panel_25 = Panel(""".0522
.0420
.0330
.0190
.01
.0040
.0012
0
0""")
panel_26 = Panel("""0
0
0
.0008
.0034
.0085
.0211
.0328
.05
.0778
.1278""")

# ----
# v1 caculation tabble
# P<0
# .2
panel_27 = Panel(""".2826
.2630
.2400
.1967
.1570
.1207
.0880
.0592
.0172""")
# P=>0
panel_28 = Panel("""0
.0049
.0304
.0520
.0804
.1180
.1685
.2
.2353
.2821
.3560""")

# ----
# .6
panel_29 = Panel("""0
0
0
0
0
0
0
0
0""")
panel_30 = Panel("""0
0
0
0
0
0
.0006
.0022
.0067
.0169
.0382""")

# ----
# .3
panel_31 = Panel(""".2306
.2040
.1790
.1333
.0946
.0623
.0376
.0202
.0033""")
panel_32 = Panel("""0
.0027
.0148
.03
.0503
.0790
.1191
.1445
.1760
.2186
.2923""")

# ----
# .7
panel_33 = Panel("""0
0
0
0
0
0
0
0
0""")
panel_34 = Panel("""0
0
0
0
0
0
0
0
0
0
0""")

# ----
# .4
panel_35 = Panel(""".1467
.12
.0972
.0630
.0395
.0214
.0116
.0044
0""")
panel_36 = Panel("""0
0
.0033
.0090
.0189
.0357
.0637
.0833
.1088
.1467
.2181""")

c_d_z_ae_ao_f_3 = Panel("""1.633
1.832
2.000
2.12
2.186
2.168
2.212
1.657
0.000""")
ar = Panel(""".0526
.0464
.0402
.0340
.0278
.0216
.0154
.0092
.0030""")
panel_37 = Panel(""".350
.350
.351
.355
.389
.443
.479
.5
.000""")
c_d_z_ae_ao = Panel("""1.662
1.882
2.050
2.152
2.187
2.144
1.970
1.582
0.000""")
panel_38 = Panel(""".617
.613
.601
.586
.561
.524
.463
.351
.000""")
a_c_f3 = Panel(""".616
.611
.599
.583
.558
.526
.481
.4
.000""")
br = Panel(""".0040
.0035
.0030
.0025
.0020
.0015
.0010
.0005
.000""")
b_c_f3 = Panel(""".350
.350
.350
.355
.389
.442
.478
.500
.000""")

c_d_z_ae_ao_f_3_2 = Panel("""1.633
1.832
2.000
2.12
2.186
2.168
2.127
1.657
0.000""")
panel_39 = Panel(""".350
.350
.351
.355
.389
.443
.479
.5
.000""")
ar_2 = Panel(""".0526
.0464
.0402
.0340
.0278
.0216
.0154
.0092
.0030""")
c_d_z_ae_ao_2 = Panel("""1.662
1.882
2.050
2.152
2.187
2.144
1.970
1.582
0.000""")
panel_40 = Panel(""".617
.613
.601
.586
.561
.524
.463
.351
.000""")
br_2 = Panel(""".0040
.0035
.0030
.0025
.0020
.0015
.0010
.0005
.000""")
a_c_f3_2 = Panel(""".616
.611
.599
.583
.558
.526
.481
.4
.000""")
b_c_f3_2 = Panel(""".350
.350
.350
.355
.389
.442
.478
.500
.000""")

tle = Panel("""0
0
0
0
0
0
0
0
0""")
tte = Panel("""0
0
0
0
0
0
0
0
0""")
panel_41 = Panel("""+1.0 
+0.95 
+0.9 
+0.85 
+0.8 
+0.7 
+0.6 
+0.5 
+0.4 
+0.2 
0""")
panel_42 = Panel("""-1.0 
-0.95 
-0.9 
-0.8 
-0.7 
-0.6 
-0.5 
-0.4 
-0.2""")
rev_10 = ReverseList(List=panel_41)
number_slider = Slider(0.65, range=0..1.2)  # "Ae/Ao"
D = Slider(5, range=0..15)
Z = Slider(4, range=2..7)
pitch = Slider(4, range=0..10)

# ---- group: v1
entwine = Entwine(
    Branch00=panel_28,
    Branch01=panel_32,
    Branch02=panel_36,
    Branch03=panel_26,
    Branch04=panel_30,
    Branch05=panel_34,
    Branch06=panel_24,
    Branch07=panel_20,
    Branch08=panel_22,
    FlattenInputs=True)
entwine_2 = Entwine(
    Branch00=panel_27,
    Branch01=panel_31,
    Branch02=panel_35,
    Branch03=panel_25,
    Branch04=panel_29,
    Branch05=panel_33,
    Branch06=panel_23,
    Branch07=panel_19,
    Branch08=panel_21,
    FlattenInputs=True)

# ----
entwine_3 = Entwine(
    Branch00=rev,
    Branch01=rev_5,
    Branch02=rev_6,
    Branch03=rev_3,
    Branch04=rev_7,
    Branch05=rev_8,
    Branch06=rev_9,
    Branch07=rev_4,
    Branch08=rev_2,
    FlattenInputs=True)
entwine_4 = Entwine(
    Branch00=panel,
    Branch01=panel_9,
    Branch02=panel_11,
    Branch03=panel_5,
    Branch04=panel_13,
    Branch05=panel_15,
    Branch06=panel_17,
    Branch07=panel_7,
    Branch08=panel_3,
    FlattenInputs=True)

number_slider_2 = Slider(2, range=-1..4)
series = Series(Start=0.2, Step=0.1, Count=9)
division = Division(A=D, B=2)
X = UnitX(Factor=1)
yz = YZPlane(Origin=Point(0, 0, 0))
multiplication = Multiplication(A=division, B=series)
addition = Addition(A=entwine_2, B=entwine_4)
addition_2 = Addition(A=entwine, B=entwine_3)
line = LineSDL(Start=yz, Direction=X, Length=number_slider_2)
pipe = Pipe(Curve=line, Radius=expr(".2*x*.5", division), Caps=1)
expression = Expression(d=D, a=number_slider, z=Z, r1=c_d_z_ae_ao_f_3_2, r2=c_d_z_ae_ao_2, Expression="If(z=3, (r1*d*a)/z,(r2*d*a)/z)")
_90 = Slider(90, range=0..360)
expression_2 = Expression(c=expression, z=Z, r1=a_c_f3_2, r2=panel_40, Expression="If(z=3, r1*c, r2*c)")
expression_3 = Expression(c=expression, z=Z, r1=b_c_f3_2, r2=panel_39, Expression="If(z=3, r1*c, r2*c)")
expression_4 = Expression(d=D, z=Z, r1=ar_2, r2=br_2, Expression="d*(r1-r2*z)")
tmax = Panel(expression_4)
subtraction = Subtraction(A=tmax, B=tle)  # -> graft(Result)
subtraction_2 = Subtraction(A=tmax, B=tte)  # -> graft(Result)
pipe_2 = Pipe(Curve=line, Radius=expr(".2*x", division), Caps=1)
sdiff = SolidDifference(BrepsA=pipe_2, BrepsB=pipe)
expression_5 = Expression(x=pitch, y=multiplication, Expression="x/(2*3.1416*y)")
projecting_cylinders = Cylinder(Base=yz, Radius=multiplication, Length=number_slider_2)
multiplication_2 = Multiplication(A=number_slider_2, B=0.1)
preview = CustomPreview(Geometry=sdiff, Shader=ColourSwatch(SwatchColor=RGB(241, 255, 84)))
volume = Volume(Geometry=pipe_2)  # -> Volume, Centroid
rad = Radians(Degrees=_90)
Z_2 = UnitZ(Factor=1)

multiplication_3 = Multiplication(A=subtraction, B=addition_2)
multiplication_4 = Multiplication(A=subtraction_2, B=addition)
addition_3 = Addition(A=multiplication_4, B=graft(tte))
addition_4 = Addition(A=multiplication_3, B=graft(tle))
multiplication_5 = Multiplication(A=subtraction, B=entwine)
multiplication_6 = Multiplication(A=subtraction_2, B=entwine_2)

addition_5 = Addition(A=multiplication_2)
atan = ArcTangent(Value=expression_5)  # -> flatten(Result)
num = Number(graft(expression_3))
subtraction_3 = Subtraction(A=expression, B=expression_3)  # -> graft(Result)
subtraction_4 = Subtraction(A=expression_2, B=expression_3)
X_2 = UnitX(Factor=addition_5)
addition_6 = Addition(A=atan, B=rad)
move = Move(Geometry=volume.Centroid, Motion=X_2)  # -> Geometry, Transform
line_2 = LineSDL(Start=move.Geometry, Direction=Z_2, Length=expr("x+2", division))
scx = SurfaceCurve(Surface=projecting_cylinders, Curve=line_2)  # -> Curves, Points, UVPoints, Normals, Parameters, Tangents
pt = ConstructPoint(XCoordinate=subtraction_4, YCoordinate=0, ZCoordinate=0)
multiplication_7 = Multiplication(A=subtraction_3, B=panel_42)
multiplication_8 = Multiplication(A=num, B=rev_10)
xy = XYPlane(Origin=scx.Points)  # -> flatten(Plane)
prot = RotatePlane(Plane=xy, Angle=addition_6)
orient = Orient(Geometry=pt, Source=PlaneXY(0, 0, 0), Target=prot)  # -> Geometry, Transform

pt_2 = ConstructPoint(XCoordinate=multiplication_7, YCoordinate=addition_3, ZCoordinate=0)
pt_3 = ConstructPoint(XCoordinate=multiplication_8, YCoordinate=addition_4, ZCoordinate=0)
pt_4 = ConstructPoint(XCoordinate=multiplication_7, YCoordinate=multiplication_6, ZCoordinate=0)
pt_5 = ConstructPoint(XCoordinate=multiplication_8, YCoordinate=multiplication_5, ZCoordinate=0)
merge = Merge(Data1=pt_4, Data2=pt_5, Data3=pt_3, Data4=pt_2)
hull = ConvexHull(Points=merge, Plane=PlaneXY(0, 0, 0))  # -> Hull, HullZ, Indices

lng = ListLength(List=orient.Geometry)
vec2pt = Vector2Pt(PointA=prot, PointB=orient.Geometry, Unitize=False)  # -> Vector, Length
move_2 = Move(Geometry=prot, Motion=vec2pt.Vector)  # -> graft(Geometry), Transform
brep = Brep(projecting_cylinders)

merge_2 = Merge(Data1=pt_4, Data2=pt_5)
merge_3 = Merge(Data1=pt_2, Data2=pt_3)
intcrv = Interpolate(Vertices=merge_2, Degree=3, Periodic=False, KnotStyle=1)  # -> Curve, Length, Domain
intcrv_2 = Interpolate(Vertices=merge_3, Degree=3, Periodic=False, KnotStyle=1)  # -> Curve, Length, Domain
orient_2 = Orient(Geometry=intcrv_2.Curve, Source=PlaneXY(0, 0, 0), Target=move_2.Geometry)  # -> flatten(Geometry), Transform
orient_3 = Orient(Geometry=intcrv.Curve, Source=PlaneXY(0, 0, 0), Target=move_2.Geometry)  # -> flatten(Geometry), Transform
project = Project(Curve=orient_3.Geometry, Brep=brep, Direction=Vector(0, 0, 1))
project_2 = Project(Curve=orient_2.Geometry, Brep=brep, Direction=Vector(0, 0, 1))
item = ListItem(List=orient.Geometry, Index=expr("x-1", lng), Wrap=True)
cull_i = CullIndex(List=project_2, Indices=1, Wrap=True)  # -> flatten(List)
cull_i_2 = CullIndex(List=project, Indices=1, Wrap=True)  # -> flatten(List)
item_2 = ListItem(List=orient.Geometry, Index=expr("x-1", lng), Wrap=True)
lng_2 = ListLength(List=cull_i)
culln = CullNth(List=cull_i, CullFrequency=lng_2)
simplify = SimplifyCurve(Curve=cull_i_2)  # -> Curve, Simplified
simplify_2 = SimplifyCurve(Curve=culln)  # -> Curve, Simplified
end = EndPoints(Curve=simplify.Curve)  # -> Start, reverse(End)
simplify_3 = SimplifyCurve(Curve=simplify_2.Curve)  # -> Curve, Simplified
end_2 = EndPoints(Curve=simplify_3.Curve)  # -> Start, reverse(End)
entwine_5 = Entwine(Branch00=end.Start, Branch01=item_2, Branch02=end.End, FlattenInputs=True)  # -> flatten(Result)
entwine_6 = Entwine(Branch00=end_2.Start, Branch01=item, Branch02=end_2.End, FlattenInputs=True)  # -> flatten(Result)
intcrv_3 = Interpolate(Vertices=entwine_5, Degree=3, Periodic=False, KnotStyle=1)  # -> Curve, Length, Domain
shatter = Shatter(Curve=intcrv_3.Curve, Parameters=item_2)
intcrv_4 = Interpolate(Vertices=entwine_6, Degree=3, Periodic=False, KnotStyle=1)  # -> Curve, Length, Domain
shatter_2 = Shatter(Curve=intcrv_4.Curve, Parameters=item_2)
netsurf = NetworkSurface(CurvesU=shatter_2, CurvesV=simplify_3.Curve, Continuity=2)
netsurf_2 = NetworkSurface(CurvesU=shatter, CurvesV=simplify.Curve, Continuity=2)
yz_2 = YZPlane(Origin=Point(0, 0, 0))
join = BrepJoin(Breps=[netsurf_2, netsurf])  # -> Breps, Closed
arrpolar = PolarArray(Geometry=join.Breps, Plane=yz_2, Count=Z, Angle=6.283185307)  # -> Geometry, Transform

orient_4 = Orient(Geometry=hull.Hull, Source=PlaneXY(0, 0, 0), Target=move_2.Geometry)  # -> flatten(Geometry), Transform
project_3 = Project(Curve=orient_4.Geometry, Brep=brep, Direction=Vector(0, 0, 1))
item_3 = ListItem(List=orient.Geometry, Index=expr("x-1", lng), Wrap=True)
cull_i_3 = CullIndex(List=project_3, Indices=1, Wrap=True)  # -> flatten(List)
merge_4 = Merge(Data1=cull_i_3, Data2=item_3)
yz_3 = YZPlane(Origin=Point(0, 0, 0))
simplify_4 = SimplifyCurve(Curve=cull_i_3)  # -> Curve, Simplified
arrpolar_2 = PolarArray(Geometry=merge_4, Plane=yz_3, Count=Z, Angle=6.283185307)  # -> Geometry, Transform

panel_43 = Panel(multiplication)
panel_44 = Panel(division)
panel_45 = Panel(subtraction_4)
pt_6 = ConstructPoint(XCoordinate=0, YCoordinate=Slider(5, range=0..10), ZCoordinate=0)
pt_7 = ConstructPoint(XCoordinate=panel_45, YCoordinate=panel_43, ZCoordinate=0)
xy_2 = XYPlane(Origin=pt_6)
orient_5 = Orient(Geometry=pt_7, Source=PlaneXY(0, 0, 0), Target=xy_2)  # -> graft(Geometry), Transform
crv = Curve(intcrv_2.Curve)
crv_2 = Curve([intcrv.Curve, intcrv_2.Curve])
move_3 = Move(Geometry=crv, Motion=orient_5.Geometry)  # -> Geometry, Transform
join_2 = JoinCurves(Curves=crv_2, Preserve=False)
lng_3 = ListLength(List=flatten(move_3.Geometry))
culln_2 = CullNth(List=flatten(move_3.Geometry), CullFrequency=lng_3)  # -> flatten(List)
item_4 = ListItem(List=flatten(orient_5.Geometry), Index=expr("x-1", lng_3), Wrap=True)
end_3 = EndPoints(Curve=culln_2)  # -> Start, reverse(End)
entwine_7 = Entwine(Branch00=end_3.Start, Branch01=item_4, Branch02=end_3.End, FlattenInputs=True)  # -> flatten(Result)
cir = Circle(Plane=xy_2, Radius=expr("x*.2", panel_44))
intcrv_5 = Interpolate(Vertices=flatten(orient_5.Geometry), Degree=3, Periodic=False, KnotStyle=1)  # -> Curve, Length, Domain
move_4 = Move(Geometry=join_2, Motion=orient_5.Geometry)  # -> Geometry, Transform
intcrv_6 = Interpolate(Vertices=entwine_7, Degree=3, Periodic=False, KnotStyle=1)  # -> Curve, Length, Domain

panel_46 = Panel(addition_6)
pt_8 = Point(volume.Centroid)
lng_4 = ListLength(List=panel_46)
crv_3 = Curve(cull_i_2)
xy_3 = XYPlane(Origin=pt_8)
culln_3 = CullNth(List=panel_46, CullFrequency=lng_4)
end_4 = EndPoints(Curve=crv_3)  # -> Start, reverse(End)
pt_9 = Point(flatten(item_2))
rotate = Rotate(Geometry=crv_3, Angle=expr("-1*x+pi/2", culln_3), Plane=xy_3)  # -> Geometry, Transform
entwine_8 = Entwine(Branch00=end_4.Start, Branch01=pt_9, Branch02=end_4.End, FlattenInputs=True)  # -> flatten(Result)
pt_10 = ConstructPoint(XCoordinate=Slider(5, range=0..10), YCoordinate=0, ZCoordinate=0)
intcrv_7 = Interpolate(Vertices=entwine_8, Degree=3, Periodic=False, KnotStyle=1)  # -> Curve, Length, Domain
yz_4 = YZPlane(Origin=pt_10)
project_4 = Project(Geometry=crv_3, Plane=yz_4)  # -> Geometry, Transform
project_5 = Project(Geometry=[intcrv_7.Curve, crv_3], Plane=yz_4)  # -> Geometry, Transform
project_6 = Project(Geometry=rotate.Geometry, Plane=yz_4)  # -> Geometry, Transform
x_tremez = Extremes(Curve=project_4.Geometry, Plane=PlaneXY(0, 0, 0))  # -> Highest, Lowest
x_tremez_2 = Extremes(Curve=project_6.Geometry, Plane=PlaneXY(0, 0, 0))  # -> Highest, Lowest
pt_11 = Point(x_tremez.Highest)
X_3 = UnitX(Factor=Slider(5, range=0..10))
pt_12 = Point(x_tremez_2.Highest)
vec2pt_2 = Vector2Pt(PointA=pt_12, PointB=pt_11, Unitize=False)  # -> Vector, Length
move_5 = Move(Geometry=project_6.Geometry, Motion=vec2pt_2.Vector)  # -> Geometry, Transform
move_6 = Move(Geometry=xy_2, Motion=X_3)  # -> Geometry, Transform
end_5 = EndPoints(Curve=move_5.Geometry)  # -> Start, reverse(End)
pt_13 = Point(flatten(item_2))
project_7 = Project(Geometry=pt_13, Plane=yz_4)  # -> Geometry, Transform
entwine_9 = Entwine(Branch00=end_5.Start, Branch01=project_7.Geometry, Branch02=end_5.End, FlattenInputs=True)  # -> flatten(Result)
intcrv_8 = Interpolate(Vertices=entwine_9, Degree=3, Periodic=False, KnotStyle=1)  # -> Curve, Length, Domain
crv_4 = Curve(move_5.Geometry)
crv_5 = Curve(project_5.Geometry)
crv_6 = Curve(project_4.Geometry)
crv_7 = Curve([crv_4, intcrv_8.Curve, crv_6, crv_5])
cir_2 = Circle(Plane=move_6.Geometry, Radius=expr(".2*x", panel_44))
orient_6 = Orient(Geometry=crv_7, Source=yz_4, Target=move_6.Geometry)  # -> Geometry, Transform

preview_2 = CustomPreview(Geometry=arrpolar_2.Geometry, Shader=ColourSwatch(SwatchColor=RGB(227, 232, 86)))
preview_3 = CustomPreview(Geometry=arrpolar.Geometry, Shader=ColourSwatch(SwatchColor=RGB(138, 123, 47)))

pt_14 = Point(volume.Centroid)
X_4 = UnitX(Factor=Slider(10, range=0..10))
xz = XZPlane(Origin=pt_14)
project_8 = Project(Geometry=join.Breps, Plane=xz)  # -> Geometry, Transform
move_7 = Move(Geometry=xy_2, Motion=X_4)  # -> Geometry, Transform
num_2 = Number(panel_44)
num_3 = Number(number_slider_2)
num_4 = Number(expr(".2*x", num_2))
num_5 = Number(expr(".5*x", num_3))
orient_7 = Orient(Geometry=project_8.Geometry, Source=xz, Target=move_7.Geometry)  # -> Geometry, Transform
dom = ConstructDomain(DomainStart=num_5, DomainEnd=expr("-1*x", num_5))
dom_2 = ConstructDomain(DomainStart=num_4, DomainEnd=expr("-1*x", num_4))
scale_nu = ScaleNU(Geometry=orient_7.Geometry, Plane=move_7.Geometry, ScaleX=expr("x*-1", Slider(1, range=0..1)), ScaleY=1, ScaleZ=1)  # -> Geometry, Transform
edges = BrepEdges(Brep=scale_nu.Geometry)  # -> Naked, Interior, NonManifold
rectangle = Rectangle(Plane=move_7.Geometry, XSize=dom, YSize=dom_2, Radius=0)  # -> Rectangle, Length
crv_8 = Curve(edges.Interior)
